% Simulink data dictionary MAVLinkMissionProtocolExample.sldd

gps_raw_int = Simulink.Bus(DataScope="Imported", HeaderFile="interfaceDefinition.h")  % Generic structure to hold a GPS reading
  time_usec: uint32, Unit="usec"
  fix_type: uint8
  lat: int32
  lon: int32
  alt: int32, Unit="mm"
  eph: uint16
  epv: uint16
  vel: uint16, Unit="cm/s"
  cog: uint16

local_position_ned = Simulink.Bus(DataScope="Imported", HeaderFile="interfaceDefinition.h")
  time_boot_ms: uint32, Unit="ms"
  x: single, Unit="m"
  y: single, Unit="m"
  z: single, Unit="m"
  vx: single, Unit="m/s"
  vy: single, Unit="m/s"
  vz: single, Unit="m/s"

uavPathManagerBus = Simulink.Bus()
  mode: uint8
  position: single[3]
  params: single[4]

attitudeBus = Simulink.Bus(DataScope="Imported", HeaderFile="interfaceDefinition.h")
  time_boot_ms: uint32, Unit="ms"
  roll: single, Unit="rad"
  pitch: single, Unit="rad"
  yaw: single, Unit="rad"
  rollspeed_p: single, Unit="rad/s"
  pitchspeed_q: single, Unit="rad/s"
  yawspeed_r: single, Unit="rad/s"

uavStateBus = Simulink.Bus(HeaderFile="interfaceDefinition.h")
  pos_vel: Bus: local_position_ned
  attitude: Bus: attitudeBus
  gps: Bus: gps_raw_int